vi "BPSK_Tx_Rx_Template.gvi"   [LabVIEW Communications System Design Suite 2.0.1]
panel controls:
  "IQ rate": f64 = 200000
  "device names": "niUSRPClass"
  "carrier frequency": f64 = 400000000
  "gain Tx": f64
  "active antenna Tx": string = "TX1"
  "stop Tx": bool
  "gain Rx": f64
  "active antenna Rx": string = "RX2"
panel indicators:
  "Baseband Waveform": waveform<f64>
  "Baseband Power Spectrum_Tx": T1
  "Baseband Power Spectrum_Rx": T1
types:
  T1 = cluster{"f0": f64, "df": f64, "magnitude": f64[]}
diagram:
  w1 = cluster{"t0": timestamp, "dt": f64, "Y": c128[]} {all zero or empty}
  Property Node(instance in=w1) -> (instance out=w2)
  call "FFT Power Spectrum for 1 Chan (CDB)2.gvi"(time signal=w2, dB On (F)=TRUE) -> (power spectrum=w3)
  $"Baseband Power Spectrum_Rx" <- w3
  Build Waveform Node() -> (output waveform=w4)
  $"Baseband Waveform" <- w4
  # Transmitter
  # Receiver
  call "niUSRP Open Rx Session.gvi"(device names=$"device names") -> (error out=w5, session handle out=w6)
  call "niUSRP Configure Signal.gvi"(session handle=w6, IQ rate=$"IQ rate", carrier frequency=$"carrier frequency", gain=$"gain Rx", error in=w5, active antenna=$"active antenna Rx") -> (session handle out=w7, coerced carrier frequency=w8, error out=w9)
  Subtract(x=w8, y=20000) -> w10
  Property Node(instance in=w7, "LO Frequency"=w10) -> (instance out=w11)
  call "niUSRP Initiate.gvi"(session handle=w11, error in=w9) -> (session handle out=w12, error out=w13)
  call "niUSRP Fetch Rx Data (CDB).gvi"(session handle=w12, number of samples=1000000, error in=w13) -> (session handle out=w14, error out=w15)
  call "niUSRP Close Session.gvi"(session handle=w14, error in=w15)
  w16 = cluster{"t0": timestamp, "dt": f64, "Y": c128[]} {all zero or empty}
  Property Node(instance in=w16) -> (instance out=w17)
  call "FFT Power Spectrum for 1 Chan (CDB)2.gvi"(time signal=w17, dB On (F)=TRUE) -> (power spectrum=w18)
  $"Baseband Power Spectrum_Tx" <- w18
  call "niUSRP Open Tx Session.gvi"(device names=$"device names") -> (session handle out=w19, error out=w20)
  call "niUSRP Configure Signal.gvi"(session handle=w19, IQ rate=$"IQ rate", carrier frequency=$"carrier frequency", gain=$"gain Tx", error in=w20, active antenna=$"active antenna Tx") -> (session handle out=w21, error out=w22)
  while {
    call "niUSRP Write Tx Data (CDB).gvi"(session handle=w21, error in=w22) -> (session handle out=w23, error out=w24)
    stop if $"stop Tx"
  }
  call "niUSRP Close Session.gvi"(session handle=w23, error in=w24)
